# Grasshopper definition 03_robot_grasshopper_from_ros.ghx (Grasshopper 1.0.7)

unit_z = UnitZ(Factor=1)
unit_x = UnitX(Factor=1)
cross_product = CrossProduct(VectorA=unit_x, VectorB=unit_z, Unitize=False)  # -> Vector, Length
curve = Curve(<curve referenced from the Rhino model>)
point = Point(Point(0.8493207802, 0.08403444175, 0.7002893508))
unit_z_2 = UnitZ(Factor=1)
divide_curve = DivideCurve(Curve=curve, Count=5, Kinks=False)  # -> Points, Tangents, Parameters
construct_plane = ConstructPlane(Origin=point, XAxis=unit_x, YAxis=cross_product.Vector)

# ----
# Robot from ROS
connect = BooleanToggle(True)
compas_fab_ros_connect = COMPASFABROSConnect(connect=connect)  # -> ros_client, is_connected; inputs port: Int32, connect: Boolean
#   port ip: The ip address ROS. Defaults to 127.0.0.1.
#   port port: The port of ROS. Defaults to 9090.
#   port connect: If True, connects to ROS. If False, disconnects from ROS. Defaults to False.
#   port ros_client: The ROS client.
#   port is_connected: True if connection established.
# ---------- compas_fab_ros_connect: Python ----------
"""
Connect or disconnect to ROS.

COMPAS FAB v0.28.0
"""

from ghpythonlib.componentbase import executingcomponent as component
from scriptcontext import sticky as st

from compas_fab.backends import RosClient
from compas_fab.ghpython.components import create_id


class ROSConnect(component):
    def RunScript(self, ip, port, connect):
        ros_client = None

        ip = ip or "127.0.0.1"
        port = port or 9090

        key = create_id(self, "ros_client")
        ros_client = st.get(key, None)

        if ros_client:
            st[key].close()
        if connect:
            st[key] = RosClient(ip, port)
            st[key].run(5)

        ros_client = st.get(key, None)
        is_connected = ros_client.is_connected if ros_client else False
        return (ros_client, is_connected)
# ---------- end compas_fab_ros_connect ----------
panel = Panel(compas_fab_ros_connect.is_connected)
compas_fab_ros_robot = COMPASFABROSRobot(ros_client=compas_fab_ros_connect.ros_client, load=Button())  # -> robot; inputs load: Boolean
#   port ros_client: The ROS client.
#   port load: If True, loads the robot from ROS. Defaults to False.
# ---------- compas_fab_ros_robot: Python ----------
"""
Load robot directly from ROS.

COMPAS FAB v0.28.0
"""

from compas.scene import SceneObject
from ghpythonlib.componentbase import executingcomponent as component
from scriptcontext import sticky as st

from compas_fab.ghpython.components import create_id


class ROSRobot(component):
    def RunScript(self, ros_client, load):
        key = create_id(self, "robot")

        if ros_client and ros_client.is_connected and load:
            # Load URDF from ROS
            st[key] = ros_client.load_robot(load_geometry=True, precision=12)
            st[key].scene_object = SceneObject(st[key].model)

        robot = st.get(key, None)
        if robot:  # client sometimes need to be restarted, without needing to reload geometry
            robot.client = ros_client
        return robot
# ---------- end compas_fab_ros_robot ----------

cross_product_2 = CrossProduct(VectorA=divide_curve.Tangents, VectorB=unit_z_2, Unitize=False)  # -> Vector, Length
draw = GhPythonScript(planes=construct_plane, scale=Slider(0.1, range=0..1))  # -> P, V, C, W; inputs planes: list
# ---------- draw: Python ----------
from System.Drawing import Color

red = Color.FromArgb(255, 0, 0)
green = Color.FromArgb(0, 255, 0)
blue = Color.FromArgb(0, 0, 255)

P = []
V = []
C = []

scale = float(scale)

for plane in planes:
    if not plane:
        continue
    P += [plane.Origin] * 3
    V.append(plane.XAxis * scale)
    V.append(plane.YAxis * scale)
    V.append(plane.ZAxis * scale)
    C += [red, green, blue]

W = 3
# ---------- end draw ----------
construct_plane_2 = ConstructPlane(Origin=divide_curve.Points, XAxis=divide_curve.Tangents, YAxis=cross_product_2.Vector)
vdisex = VectorDisplayEx(Point=draw.P, Vector=draw.V, Colour=draw.C, Width=draw.W)
draw_2 = GhPythonScript(planes=construct_plane_2, scale=Slider(0.1, range=0..1))  # -> P, V, C, W; inputs planes: list; same code as draw
vdisex_2 = VectorDisplayEx(Point=draw_2.P, Vector=draw_2.V, Colour=draw_2.C, Width=draw_2.W)

# ---- group: forward kinematics
# Configuration
a1 = Slider(0, range=-360..360)
a3 = Slider(90, range=-360..360)
a4 = Slider(-90, range=-360..360)
a5 = Slider(-90, range=-360..360)
a6 = Slider(0, range=-360..360)
a2 = Slider(-90, range=-360..360)
forward_kinematics = PythonScript(robot=compas_fab_ros_robot, a1=a1, a2=a2, a3=a3, a4=a4, a5=a5, a6=a6)  # -> config, frame
# ---------- forward_kinematics: Python ----------
import math
from compas_robots import Configuration
from compas_rhino.conversions import frame_to_rhino_plane

if robot:
    config = robot.zero_configuration()
    config.joint_values = [math.radians(v) for v in (a1, a2, a3, a4, a5, a6)]
    frame = frame_to_rhino_plane(robot.forward_kinematics(config))
# ---------- end forward_kinematics ----------

# ----
compas_fab_plan_cartesian_motion = COMPASFABPlanCartesianMotion(
    robot=compas_fab_ros_robot,
    planes=construct_plane_2,
    start_configuration=forward_kinematics.config,
    compute=Toggle(True))  # -> trajectory; inputs planes: list, attached_collision_meshes: list, path_constraints: list, compute: Boolean
#   port planes: The planes or frames through which the path is defined.
#   port start_configuration: The robot's full configuration, i.e. values for all configurable joints of the entire robot, at the starting position. Defaults to the all-zero configuration.
#   port group: The planning group used for calculation. Defaults to the robot's main planning group.
#   port attached_collision_meshes: A list of attached collision meshes to be included for planning.
#   port path_constraints: Optional constraints that can be imposed along the solution path. Note that path calculation won't work if the start_configuration violates these constraints. Defaults to None.
#   port max_step: The approximate distance between the calculated points. (Defined in the robot's units.) Defaults to 0.01.
#   port compute: If True, calculates a trajectory.
#   port trajectory: The calculated trajectory.
# ---------- compas_fab_plan_cartesian_motion: Python ----------
"""
Calculate a cartesian motion path (linear in tool space).

COMPAS FAB v1.0.2
"""

from compas_rhino.conversions import plane_to_compas_frame
from ghpythonlib.componentbase import executingcomponent as component
from scriptcontext import sticky as st

from compas_fab.ghpython.components import create_id


class PlanCartesianMotion(component):
    def RunScript(
        self, robot, planes, start_configuration, group, attached_collision_meshes, path_constraints, max_step, compute
    ):
        key = create_id(self, "trajectory")

        max_step = float(max_step) if max_step else 0.01
        path_constraints = list(path_constraints) if path_constraints else None
        attached_collision_meshes = list(attached_collision_meshes) if attached_collision_meshes else None

        if robot and robot.client and robot.client.is_connected and start_configuration and planes and compute:
            frames = [plane_to_compas_frame(plane) for plane in planes]
            st[key] = robot.plan_cartesian_motion(
                frames,
                start_configuration=start_configuration,
                group=group,
                options=dict(
                    max_step=max_step,
                    path_constraints=path_constraints,
                    attached_collision_meshes=attached_collision_meshes,
                ),
            )

        trajectory = st.get(key, None)
        return trajectory
# ---------- end compas_fab_plan_cartesian_motion ----------
compas_fab_inverse_kinematics = COMPASFABInverseKinematics(robot=compas_fab_ros_robot, plane=construct_plane, start_configuration=forward_kinematics.config)  # -> configuration
#   port plane: The plane or frame to calculate the inverse kinematic for.
#   port start_configuration: If passed, calculates the inverse such that the joint positions differ the least from the start_configuration. Defaults to the zero configuration.
#   port group: The planning group used for calculation. Defaults to the robot's main planning group.
#   port configuration: The planning group's configuration.
# ---------- compas_fab_inverse_kinematics: Python ----------
"""
Calculate the robot's inverse kinematic for a given plane.

COMPAS FAB v1.0.2
"""

from compas_rhino.conversions import plane_to_compas_frame
from ghpythonlib.componentbase import executingcomponent as component


class InverseKinematics(component):
    def RunScript(self, robot, plane, start_configuration, group):
        configuration = None
        if robot and robot.client and robot.client.is_connected and plane:
            frame = plane_to_compas_frame(plane)
            configuration = robot.inverse_kinematics(frame, start_configuration, group)
        return configuration
# ---------- end compas_fab_inverse_kinematics ----------
compas_fab_trajectory_visualize = COMPASFABTrajectoryVisualize(robot=compas_fab_ros_robot, trajectory=compas_fab_plan_cartesian_motion)  # -> start_configuration, configurations, fraction, time, planes, P, V, A
#   port group: The planning group for which this trajectory was planned.
#   port trajectory: The calculated trajectory.
#   port start_configuration: The start configuration of the trajectory.
#   port configurations: The full configurations along the trajectory.
#   port fraction: Indicates the fraction of requested trajectory that was calculated, e.g. 1 means the full trajectory was found.
#   port time: The time which is needed to execute that trajectory at full speed.
#   port planes: The planes of the robot's end-effector.
#   port P: The positions along the trajectory
#   port V: The velocities along the trajectory
#   port A: The accelerations along the trajectory
# ---------- compas_fab_trajectory_visualize: Python ----------
"""
Visualizes a trajectory.

COMPAS FAB v1.0.2
"""

from compas_ghpython import draw_frame
from compas_ghpython.sets import list_to_ghtree
from ghpythonlib.componentbase import executingcomponent as component


class TrajectoryVisualize(component):
    def RunScript(self, robot, group, trajectory):
        start_configuration = None
        configurations = []
        fraction = 0.0
        time = 0.0

        planes = []
        positions = []
        velocities = []
        accelerations = []

        if robot and trajectory:
            group = group or robot.main_group_name

            for c in trajectory.points:
                configurations.append(
                    robot.merge_group_with_full_configuration(c, trajectory.start_configuration, group)
                )
                frame = robot.forward_kinematics(c, group, options=dict(solver="model"))
                planes.append(draw_frame(frame))
                positions.append(c.positions)
                velocities.append(c.velocities)
                accelerations.append(c.accelerations)

            start_configuration = trajectory.start_configuration
            fraction = trajectory.fraction
            time = trajectory.time_from_start

        P = list_to_ghtree(list(zip(*positions)))
        V = list_to_ghtree(list(zip(*velocities)))
        A = list_to_ghtree(list(zip(*accelerations)))

        # return outputs if you have them; here I try it for you:
        return (start_configuration, configurations, fraction, time, planes, P, V, A)
# ---------- end compas_fab_trajectory_visualize ----------
list_item = ListItem(List=compas_fab_trajectory_visualize.configurations, Index=Slider(76, range=0..154), Wrap=True)
panel_2 = Panel(compas_fab_trajectory_visualize.configurations)
panel_3 = Panel(compas_fab_trajectory_visualize.fraction)

# ----
# Visualization
show_end_effector_frame = BooleanToggle(True)
show_base_frame = BooleanToggle(True)
show_collision = BooleanToggle(False)
show_cm_acm = BooleanToggle(False)
show_frames = BooleanToggle(True)
show_visual = BooleanToggle(True)
compas_fab_robot_visualize = COMPASFABRobotVisualize(
    robot=compas_fab_ros_robot,
    configuration=list_item,
    show_visual=show_visual,
    show_collision=show_collision,
    show_frames=show_frames,
    show_base_frame=show_base_frame,
    show_end_effector_frame=show_end_effector_frame,
    show_cm=show_cm_acm,
    show_acm=show_cm_acm)  # -> visual, collision, collision_meshes, attached_meshes, frames, base_frame, ee_frame; inputs show_visual: Boolean, show_collision: Boolean, show_frames: Boolean, show_base_frame: Boolean, show_end_effector_frame: Boolean, show_cm: Boolean, show_acm: Boolean
#   port group: The planning group used for end-effector and base visualization.
#   port configuration: The robot's full configuration.
#   port show_visual: Whether or not to show the robot's visual meshes.
#   port show_collision: Whether or not to show the robot's collision meshes.
#   port show_frames: Whether or not to show the robot's joint frames.
#   port show_base_frame: Whether or not to show the robot's base frame.
#   port show_end_effector_frame: Whether or not to show the robot's end-effector frame.
#   port show_cm: Whether or not to show the collision meshes (if any).
#   port show_acm: Whether or not to show the attached collision meshes (if any).
#   port visual: Rhino meshes of the robot's visual geometry (if any).
#   port collision: Rhino meshes of the robot's collision geometry (if any).
#   port collision_meshes: Rhino meshes of the scene's collision meshes (if any).
#   port attached_meshes: Rhino meshes of the scene's attached collision meshes (if any).
#   port frames: The robot's joint frames as Rhino planes (if any).
#   port base_frame: The robot's base frame as a Rhino plane (if any).
#   port ee_frame: The robot's end-effector frame as a Rhino plane (if any).
# ---------- compas_fab_robot_visualize: Python ----------
"""
Visualizes the robot.

COMPAS FAB v0.28.0
"""

import time

from compas.geometry import Frame
from compas.geometry import Transformation
from compas_rhino.conversions import frame_to_rhino_plane
from compas_ghpython import create_id
from ghpythonlib.componentbase import executingcomponent as component
from scriptcontext import sticky as st

from compas_fab.robots import PlanningScene


class RobotVisualize(component):
    def RunScript(
        self,
        robot,
        group,
        configuration,
        show_visual,
        show_collision,
        show_frames,
        show_base_frame,
        show_end_effector_frame,
        show_cm,
        show_acm,
    ):
        visual = None
        collision = None
        collision_meshes = None
        attached_meshes = None
        frames = None
        base_frame = None
        ee_frame = None

        if robot:
            show_visual = True if show_visual is None else show_visual
            show_cm = True if show_cm is None else show_cm
            show_acm = True if show_acm is None else show_acm
            configuration = configuration or robot.zero_configuration()

            robot.update(configuration, visual=show_visual, collision=show_collision)
            compas_frames = robot.transformed_frames(configuration, group)

            if show_visual:
                visual = robot.scene_object.draw_visual()

            if show_collision:
                collision = robot.scene_object.draw_collision()

            if show_base_frame:
                base_compas_frame = compas_frames[0]
                base_frame = frame_to_rhino_plane(base_compas_frame)

            if show_end_effector_frame:
                ee_compas_frame = robot.forward_kinematics(configuration, group, options=dict(solver="model"))
                ee_frame = frame_to_rhino_plane(ee_compas_frame)

            if show_frames:
                frames = []
                for compas_frame in compas_frames[1:]:
                    frames.append(frame_to_rhino_plane(compas_frame))

            cached_scene_key = create_id(self, "cached_scene")

            if show_cm or show_acm:
                cached_scene = st.get(cached_scene_key)
                if not cached_scene:
                    cached_scene = {"time": 0}

                # expire cache if the component has not been executed in the last 2 seconds
                # this allows to slide through a list of configurations
                # without triggering refreshes of the scene in the middle of it
                if time.time() - cached_scene["time"] > 2:
                    update_scene = True
                else:
                    update_scene = False

                if update_scene:
                    scene = PlanningScene(robot)
                    scene = robot.client.get_planning_scene()

                if update_scene and show_cm:
                    collision_meshes = []

                    for co in scene.world.collision_objects:
                        header = co.header
                        frame_id = header.frame_id
                        cms = co.to_collision_meshes()

                        for cm in cms:
                            if cm.frame != Frame.worldXY():
                                t = Transformation.from_frame(cm.frame)
                                mesh = cm.mesh.transformed(t)
                            else:
                                mesh = cm.mesh

                            collision_meshes.extend(SceneObject(mesh).draw())

                        cached_scene["cm"] = collision_meshes

                collision_meshes = cached_scene.get("cm", [])

                if update_scene and show_acm:
                    attached_meshes = []

                    for aco in scene.robot_state.attached_collision_objects:
                        for acm in aco.to_attached_collision_meshes():
                            frame_id = aco.object["header"]["frame_id"]
                            frame = robot.forward_kinematics(configuration, options=dict(link=frame_id))
                            t = Transformation.from_frame(frame)

                            # Local CM frame
                            if acm.collision_mesh.frame and acm.collision_mesh.frame != Frame.worldXY():
                                t = t * Transformation.from_frame(acm.collision_mesh.frame)

                            mesh = acm.collision_mesh.mesh.transformed(t)

                            attached_meshes.extend(SceneObject(mesh).draw())

                    cached_scene["acm"] = attached_meshes

                attached_meshes = cached_scene.get("acm", [])

                cached_scene["time"] = time.time()
                st[cached_scene_key] = cached_scene

        return (
            visual,
            collision,
            collision_meshes,
            attached_meshes,
            frames,
            base_frame,
            ee_frame,
        )
# ---------- end compas_fab_robot_visualize ----------
draw_3 = GhPythonScript(
    planes=[compas_fab_robot_visualize.frames, compas_fab_robot_visualize.base_frame, compas_fab_robot_visualize.ee_frame],
    scale=Slider(0.1, range=0..1))  # -> P, V, C, W; inputs planes: list; same code as draw
vdisex_3 = VectorDisplayEx(Point=draw_3.P, Vector=draw_3.V, Colour=draw_3.C, Width=draw_3.W)
